# Grasshopper definition Courtyard.gh (Grasshopper 1.0.7)
# plug-ins: ThreePlus, Telepathy, LunchBox

geo = Geometry(<point referenced from the Rhino model>)
cluster = Cluster(crv=<geometry referenced from the Rhino model>, circulation=geo, fillet=Slider(2, range=0..10), offset=-20, ceiling=4)  # -> footprints_2, floors_2
Z = UnitZ(Factor=expr("x*-1", Slider(4, range=0..10)))
hemisphere_light = HemisphereLight(ZenithColor=RGB(255, 255, 255), HorizonColor=RGB(128, 128, 128), Intensity=Slider(4, range=0..10))
extr = Extrude(Base=cluster.floors_2, Direction=Z)
sceneobjects = RemoteSender(hemisphere_light)
physical_material = PhysicalMaterial(
    Model=extr,
    Color=ColourSwatch(SwatchColor=RGB(212, 212, 212)),
    Roughness=0.1,
    Reflectivity=0.5,
    Metalness=0.5,
    Sheen=0,
    SheenColor=RGB(255, 255, 255),
    Clearcoat=0)
ambient_light = AmbientLight(Color=ColourSwatch(SwatchColor=RGB(212, 207, 197)), Intensity=1)
area = Area(Geometry=cluster.floors_2)  # -> flatten(Area), Centroid
sceneobjects_2 = RemoteSender(physical_material)
path = FilePath("D:\gh-front\public\data\")
sceneobjects_3 = RemoteSender(ambient_light)
sceneobjects_4 = RemoteReceiver(flatten([sceneobjects_2, sceneobjects_3, sceneobjects]))
csv = CreateCSV(DataGridHeaders="FloorAreas", ValueTree=area.Area, Delimiter=",")
scene = Scene(SceneObjects=sceneobjects_4)
savejson = SaveJson(Scene=scene, FolderPath=path, FolderName="Scene", Save=invert(False))
panel = Panel(csv)

# ==== cluster Cluster
crv = ClusterInput()
number_slider = Slider(5, range=0..10)
fillet = ClusterInput()
crv_2 = Curve(crv)
simplify = SimplifyCurve(Curve=crv_2, Tolerance=Slider(2, range=0..10))  # -> simplify(Curve), Simplified
fillet_2 = Number(fillet)
redpline = Reduce(Polyline=simplify.Curve, Tolerance=Slider(2, range=0..10))  # -> Polyline, Reduction
fillet_3 = Fillet(Curve=redpline.Polyline, Radius=fillet_2)  # -> flatten(Curve)
explode = Explode(Curve=fillet_3, Recursive=True)  # -> Segments, Vertices
offset = ClusterInput()
pline = PolyLine(Vertices=explode.Vertices, Closed=invert(False))
Z = UnitZ(Factor=1)
offset_2 = Number(offset)
extr = Extrude(Base=pline, Direction=Z)
panel = Panel(extr)
offsetbrep = OffsetBrep(Brep=extr, OffsetDistance=offset_2, Solid=False, SharpEdges=True, Tolerance=0.001)
sec = BrepPlane(Brep=extr, Plane=PlaneXY(0, 0, 0))  # -> Curves, Points
sec_2 = BrepPlane(Brep=offsetbrep, Plane=PlaneXY(0, 0, 0))  # -> Curves, Points
rdiff = RegionDifference(CurvesA=sec.Curves, CurvesB=sec_2.Curves)  # -> flatten(Result)
graft = GraftTree(Tree=flatten(sec_2.Curves), IncludeEmptyLists=True, IncludeNullItems=True)  # -> simplify(Tree)
boundary = BoundarySurfaces(Edges=rdiff)
graft_2 = GraftTree(Tree=flatten(sec.Curves), IncludeEmptyLists=True, IncludeNullItems=True)  # -> simplify(Tree)
footprints = Geometry(boundary)
footprints_2 = ClusterOutput(footprints)
clean = CleanTree(RemoveNulls=True, RemoveInvalid=True, RemoveEmpty=invert(False), Tree=graft_2)
circulation = ClusterInput()
ptdivcrvtarg = PointDivideCurveTargetLength(Curve=graft, Target=Slider(15, range=0..100), DivisionType=0, EndPoint=False)  # -> Points, Tangents, Parameters, Length, R
circulation_2 = Geometry(circulation)
crv_cp = CurveClosestPoint(Point=ptdivcrvtarg.Points, Curve=graft_2)  # -> Point, Parameter, Distance
Z_2 = UnitZ(Factor=1)
data = Data(graft(boundary))
ln = Line(StartPoint=ptdivcrvtarg.Points, EndPoint=crv_cp.Point)
move = Move(Geometry=data, Motion=Z_2)  # -> Geometry, Transform
crv_cp_2 = CurveClosestPoint(Point=circulation_2, Curve=clean)  # -> Point, Parameter, Distance
srfsplit = SurfaceSplit(Surface=move.Geometry, Curves=ln)  # -> simplify(Fragments)
area = Area(Geometry=srfsplit)  # -> Area, Centroid
dist = Distance(PointA=crv_cp_2.Point, PointB=area.Centroid)
addition = Addition(B=dist)
one_over_x = OneOverX(Value=addition)
sort = SortList(Keys=flatten(one_over_x))  # -> Keys, ValuesA
item = ListItem(List=reverse(sort.Keys), Index=0, Wrap=True)
item_2 = ListItem(List=sort.Keys, Index=0, Wrap=True)
dom = ConstructDomain(DomainStart=item_2, DomainEnd=item)
data_2 = Data(srfsplit)
ceiling = ClusterInput()
remap = RemapNumbers(Value=one_over_x, Source=dom, Target="2 To 8")  # -> Mapped, Clipped
int = Integer(remap.Mapped)
Z_3 = UnitZ(Ceiling=ceiling)
arrlinear = LinearArray(Geometry=simplify(data_2), Direction=Z_3, Count=simplify(int))  # -> graft(Geometry), Transform
area_2 = Area(Geometry=arrlinear.Geometry)  # -> Area, Centroid
pdecon = Deconstruct(Point=area_2.Centroid)  # -> XComponent, YComponent, ZComponent
bnd = Bounds(Numbers=flatten(pdecon.ZComponent))
div = DivideDomain(Domain=bnd, Count=Slider(3, range=0..10))
panel_2 = Panel("""-5
-7
-9""")
inc = Includes(Value=pdecon.ZComponent, Domain=div)  # -> simplify(Includes), Deviation
data_3 = Data(simplify(extr))
data_4 = Data(arrlinear.Geometry)
cull = CullPattern(List=panel_2, CullPattern=inc.Includes)
item_3 = ListItem(List=cull, Index=0, Wrap=True)
area_3 = Area(Geometry=data_4)  # -> Area, Centroid
pshift = ShiftPaths(Data=item_3, Offset=Slider(-2, range=-2..0))
pdecon_2 = Deconstruct(Point=area_3.Centroid)  # -> XComponent, YComponent, ZComponent
offsetbrep_2 = OffsetBrep(Brep=data_3, OffsetDistance=pshift, Solid=False, SharpEdges=invert(True), Tolerance=0.001)
data_5 = Data(simplify(pdecon_2.ZComponent))
pshift_2 = ShiftPaths(Data=data_4, Offset=Slider(-2, range=-2..0))
pshift_3 = ShiftPaths(Data=offsetbrep_2, Offset=-1)
pshift_4 = ShiftPaths(Data=data_5, Offset=Slider(-2, range=-2..0))
Z_4 = UnitZ(Factor=expr("x+0.5", pshift_4))
move_2 = Move(Geometry=pshift_3, Motion=Z_4)  # -> Geometry, Transform
split = SplitBrep(Brep=graft(pshift_2), Cutter=graft(move_2.Geometry))
Z_5 = UnitZ(Factor=Slider(3, range=0..10))
item_4 = ListItem(List=split, Index=expr("1", 0), Wrap=True)
move_3 = Move(Geometry=item_4, Motion=Z_5)  # -> Geometry, Transform
floors = Geometry(simplify(move_3.Geometry))
floors_2 = ClusterOutput(floors)
